# Grasshopper definition KinergyMainInterface.gh (Grasshopper 1.0.7)
# plug-ins: Human UI

# ---- group: Top Menu
number_slider = Slider(0, range=0..100)
width = Slider(186, range=0..1000)
height = Slider(35, range=0..1000)
width_2 = Slider(85, range=0..1000)
height_2 = Slider(35, range=0..1000)
width_3 = Slider(95, range=0..1000)
height_3 = Slider(35, range=0..1000)
width_4 = Slider(90, range=0..1000)
height_4 = Slider(35, range=0..1000)
radiobtn = CreateRadioButton(RadioButtonName="Intermittent", RadioButtonGroup="motion type", InitiallySelected=False)
adjustpos = AdjustElementPositioning(
    ElementsToAdjust=radiobtn,
    Margin="290,-45,0,10",
    AbsolutePositioning=False,
    Width=width_4,
    Height=height_4,
    HorizontalAlignment=Slider(0, range=0..100))
radiobtn_2 = CreateRadioButton(RadioButtonName="Reciprocated", RadioButtonGroup="motion type", InitiallySelected=False)
adjustpos_2 = AdjustElementPositioning(
    ElementsToAdjust=radiobtn_2,
    Margin="180,-45,0,10",
    AbsolutePositioning=False,
    Width=width_3,
    Height=height_3,
    HorizontalAlignment=Slider(0, range=0..100))
radiobtn_3 = CreateRadioButton(RadioButtonName="Instant", RadioButtonGroup="motion type", InitiallySelected=False)
adjustpos_3 = AdjustElementPositioning(
    ElementsToAdjust=radiobtn_3,
    Margin="5,-10,0,10",
    AbsolutePositioning=False,
    Width=width,
    Height=height,
    HorizontalAlignment=number_slider)
radiobtn_4 = CreateRadioButton(RadioButtonName="Continuous", RadioButtonGroup="motion type", InitiallySelected=False)
adjustpos_4 = AdjustElementPositioning(
    ElementsToAdjust=radiobtn_4,
    Margin="80,-45,0,10",
    AbsolutePositioning=False,
    Width=width_2,
    Height=height_2,
    HorizontalAlignment=Slider(0, range=0..100))
label = CreateLabel(LabelText="Select a target motion type:", LabelSize=12, Justification=0)
adjustpos_5 = AdjustElementPositioning(
    ElementsToAdjust=label,
    Margin="0,0,0,5",
    AbsolutePositioning=False,
    Width=width,
    Height=height,
    HorizontalAlignment=number_slider)

# ---- group: Reset Motion
width_5 = Slider(50, range=0..1000)
height_5 = Slider(30, range=0..1000)
button = CreateButton(ButtonName="Clear", ButtonStyle=0)
adjustpos_6 = AdjustElementPositioning(
    ElementsToAdjust=button,
    Margin="270,-45,0,10",
    AbsolutePositioning=False,
    Width=width_5,
    Height=height_5,
    HorizontalAlignment=Slider(0, range=0..100))
values = ValueListener(Elements=button, SomeProperty=True)  # -> Values, Indices

# ---- group: Motion Selection Logic
values_2 = ValueListener(Elements=radiobtn_3, SomeProperty=True)  # -> Values, Indices
values_3 = ValueListener(Elements=radiobtn_4, SomeProperty=True)  # -> Values, Indices
values_4 = ValueListener(Elements=radiobtn_2, SomeProperty=True)  # -> Values, Indices
values_5 = ValueListener(Elements=radiobtn, SomeProperty=True)  # -> Values, Indices
rotating = Panel(values_3.Values)
translating = Panel(values_2.Values)
oscillating = Panel(values_4.Values)
translating_oscillating = Panel(values_5.Values)
python = GhPythonScript(x=values_2.Values, y=values_3.Values, z=values_4.Values, u=values_5.Values)  # -> a, b, c, d, e
# ---------- python: Python ----------
#provides a scripting component.
#    Inputs:
#        x: Translation button listener
#        y: Rotation button listener
#        z: Oscillating button listener
#        u: Translation+oscillating button listener
#    Output:
#        a: Visibility indicator for the translation control panel
#        b: Visibility indicator for the rotation control panel
#        c: Visibility indicator for the oscillating control panel
#        d: Visibility indicator for the translation + oscillating control panel
#        e: Visibility indicator for the default control panel
#
#__author__ = "ediga"
#__version__ = "2020.07.28"

import rhinoscriptsyntax as rs


if x and not y and not z and not u:
    a = True
    b = False
    c = False
    d = False
    e = False
elif not x and y and not z and not u:
    a = False
    b = True
    c = False
    d = False
    e = False
elif not x and not y and z and not u:
    a = False
    b = False
    c = True
    d = False
    e = False
elif not x and not y and not z and u:
    a = False
    b = False
    c = False
    d = True
    e = False
else:
    a = False
    b = False
    c = False
    d = False
    e = True
# ---------- end python ----------

# ---- group: Instant Motion
separatorheight = Slider(4, range=0..10)
colour = ColourPicker(PickedColour=RGB(230, 230, 230))
colour_2 = ColourPicker(PickedColour=RGB(101, 168, 99))
angle = Slider(10.187, range=0..20)
width_6 = Slider(566, range=0..1000)
height_6 = Slider(38, range=0..1000)
rounds = Slider(10.187, range=0..20)
titlesize = Slider(20, range=0..30)
strength = Slider(0.5, range=0..1)
displacement = Slider(10.187, range=0..20)
width_7 = Slider(380, range=0..400)
height_7 = Slider(30, range=0..30)
separator = CreateSeparator(Thickness=0.5, Horizontal=True, Color=colour, Height=separatorheight)
label_2 = CreateLabel(LabelText="Kinetic Unit for Instant Motion", LabelSize=12, Justification=0)
width_8 = Slider(203, range=0..1000)
height_8 = Slider(35, range=0..1000)
label_3 = CreateLabel(LabelText="Output trajectory:", LabelSize=12, Justification=0)
width_9 = Slider(385, range=0..400)
height_9 = Slider(30, range=0..30)
width_10 = Slider(385, range=0..400)
height_10 = Slider(30, range=0..30)
adjustpos_7 = AdjustElementPositioning(
    ElementsToAdjust=label_2,
    Margin="10,5,0,20",
    AbsolutePositioning=False,
    Width=width_6,
    Height=height_6,
    HorizontalAlignment=Slider(0, range=0..100))
adjustelem = AdjustElementAppearance(ElementsToAdjust=label_2, Foreground=colour_2, FontSize=titlesize)
slider = CreateSlider(Slider=angle, ShowBounds=False, ShowTicks=False, ShowTooltip=False, ShowValLabel=True, showLabel=True)
slider_2 = CreateSlider(Slider=rounds, ShowBounds=False, ShowTicks=False, ShowTooltip=False, ShowValLabel=True, showLabel=True)
width_11 = Slider(385, range=0..400)
height_11 = Slider(30, range=0..30)
height_12 = Slider(30, range=0..1000)
width_12 = Slider(170, range=0..1000)
slider_3 = CreateSlider(Slider=strength, ShowBounds=False, ShowTicks=False, ShowTooltip=False, ShowValLabel=True, showLabel=True)
slider_4 = CreateSlider(Slider=displacement, ShowBounds=False, ShowTicks=False, ShowTooltip=False, ShowValLabel=True, showLabel=True)
adjustpos_8 = AdjustElementPositioning(
    ElementsToAdjust=label_3,
    Margin="10,5,0,10",
    AbsolutePositioning=False,
    Width=width_8,
    Height=height_8,
    HorizontalAlignment=Slider(0, range=0..100))
adjustpos_9 = AdjustElementPositioning(
    ElementsToAdjust=slider_3,
    Margin="10,20,0,10",
    AbsolutePositioning=False,
    Width=width_7,
    Height=height_7,
    HorizontalAlignment=Slider(0, range=0..100))
width_13 = Slider(170, range=0..1000)
height_13 = Slider(30, range=0..1000)
adjustpos_10 = AdjustElementPositioning(
    ElementsToAdjust=slider,
    Margin="10,10,0,5",
    AbsolutePositioning=False,
    Width=width_9,
    Height=height_9,
    HorizontalAlignment=Slider(0, range=0..100))
adjustpos_11 = AdjustElementPositioning(
    ElementsToAdjust=slider_2,
    Margin="10,10,0,5",
    AbsolutePositioning=False,
    Width=width_10,
    Height=height_10,
    HorizontalAlignment=Slider(0, range=0..100))
height_14 = Slider(38, range=0..1000)
adjustpos_12 = AdjustElementPositioning(
    ElementsToAdjust=slider_4,
    Margin="10,10,0,5",
    AbsolutePositioning=False,
    Width=width_11,
    Height=height_11,
    HorizontalAlignment=Slider(0, range=0..100))
label_4 = CreateLabel(LabelText="Instant Motion", LabelSize=12, Justification=0)
width_14 = Slider(566, range=0..1000)
width_15 = Slider(110, range=0..1000)
height_15 = Slider(35, range=0..1000)
separatorheight_2 = Slider(10, range=0..10)
true_button = CreateTrueOnlyButton(ButtonName="Select the end-effector", ButtonStyle=0)
radiobtn_5 = CreateRadioButton(RadioButtonName="Line", RadioButtonGroup="instant_motion", InitiallySelected=False)
values_6 = ValueListener(Elements=radiobtn_5, SomeProperty=True)  # -> Values, Indices
colour_3 = ColourPicker(PickedColour=RGB(230, 230, 230))
width_16 = Slider(400, range=0..1000)
adjustpos_13 = AdjustElementPositioning(
    ElementsToAdjust=true_button,
    Margin="210,-40,0,10",
    AbsolutePositioning=False,
    Width=width_13,
    Height=height_13,
    HorizontalAlignment=Slider(0, range=0..100))
adjustpos_14 = AdjustElementPositioning(
    ElementsToAdjust=label_4,
    Margin="10,5,0,10",
    AbsolutePositioning=False,
    Width=width_14,
    Height=height_14,
    HorizontalAlignment=Slider(0, range=0..100))
separator_2 = CreateSeparator(Thickness=0.5, Horizontal=True, Color=colour_3, Width=width_16, Height=separatorheight_2)
adjustpos_15 = AdjustElementPositioning(
    ElementsToAdjust=radiobtn_5,
    Margin="130,-55,0,10",
    AbsolutePositioning=False,
    Width=width_15,
    Height=height_15,
    HorizontalAlignment=Slider(0, range=0..100))
titlesize_2 = Slider(20, range=0..30)
colour_4 = ColourPicker(PickedColour=RGB(51, 121, 200))
checkbox = CreateCheckbox(Label="Add a lock", StartingValue=False)
colour_5 = ColourPicker(PickedColour=RGB(230, 230, 230))
button_2 = CreateButton(ButtonName="Preview", ButtonStyle=0)
adjustelem_2 = AdjustElementAppearance(ElementsToAdjust=label_4, Foreground=colour_4, FontSize=titlesize_2)
width_17 = Slider(200, range=0..1000)
height_16 = Slider(30, range=0..1000)
width_18 = Slider(450, range=0..1000)
height_17 = Slider(35, range=0..1000)
height_18 = Slider(35, range=0..1000)
width_19 = Slider(115, range=0..1000)
radiobtn_6 = CreateRadioButton(RadioButtonName="Circle", RadioButtonGroup="instant_motion", InitiallySelected=False)
values_7 = ValueListener(Elements=radiobtn_6, SomeProperty=True)  # -> Values, Indices
separatorheight_3 = Slider(4, range=0..10)
height_19 = Slider(35, range=0..1000)
width_20 = Slider(115, range=0..1000)
width_21 = Slider(400, range=0..1000)
adjustpos_16 = AdjustElementPositioning(
    ElementsToAdjust=button_2,
    Margin="180,-45,0,10",
    AbsolutePositioning=False,
    Width=width_17,
    Height=height_16,
    HorizontalAlignment=Slider(0, range=0..100))
adjustpos_17 = AdjustElementPositioning(ElementsToAdjust=checkbox, Margin="15,15,0,10", AbsolutePositioning=False, Width=width_18, Height=height_17)
radiobtn_7 = CreateRadioButton(RadioButtonName="Arc", RadioButtonGroup="instant_motion", InitiallySelected=False)
adjustpos_18 = AdjustElementPositioning(
    ElementsToAdjust=radiobtn_6,
    Margin="190,-55,0,10",
    AbsolutePositioning=False,
    Width=width_19,
    Height=height_18,
    HorizontalAlignment=Slider(0, range=0..100))
values_8 = ValueListener(Elements=radiobtn_7, SomeProperty=True)  # -> Values, Indices
python_2 = GhPythonScript(x=values_6.Values, y=values_7.Values, z=values_8.Values)  # -> a, c, d, e
# ---------- python_2: Python ----------
"""Provides a scripting component.
    Inputs:
        x: Line
        y: Circle
        z: Arc
    Output:
        a: button 1 lable
        c: hide or show the slide bar for translation
        d: hide or show the slide bar for rotation
        e: hide or show the slide bar for hinge pivoting"""

__author__ = "ediga"
__version__ = "2020.07.29"

import rhinoscriptsyntax as rs

if x and not y and not z:
    a = "Set the region and direction"
    c = True
    d = False
    e = False
elif not x and y and not z:
    a = "Set the region and axis"
    c = False
    d = True
    e = False
elif not x and not y and z:
    a = "Set the region and axis"
    c = False
    d = False
    e = True
else:
    a = "Set the region and direction"
    c = True
    d = False
    e = False
# ---------- end python_2 ----------
hideshow = HideShowElement(ElementToHideShow=slider, Show=python_2.e, Collapse=Toggle(True), Disable=Toggle(False))
hideshow_2 = HideShowElement(ElementToHideShow=slider_2, Show=python_2.d, Collapse=Toggle(True), Disable=Toggle(False))
hideshow_3 = HideShowElement(ElementToHideShow=slider_4, Show=python_2.c, Collapse=Toggle(True), Disable=Toggle(False))
panel = Panel(python_2.a)
true_button_2 = CreateTrueOnlyButton(ButtonName=panel, ButtonStyle=0)
adjustpos_19 = AdjustElementPositioning(
    ElementsToAdjust=true_button_2,
    Margin="15,0,0,10",
    AbsolutePositioning=False,
    Width=width_12,
    Height=height_12,
    HorizontalAlignment=Slider(0, range=0..100))
adjustpos_20 = AdjustElementPositioning(
    ElementsToAdjust=radiobtn_7,
    Margin="265,-55,0,10",
    AbsolutePositioning=False,
    Width=width_20,
    Height=height_19,
    HorizontalAlignment=Slider(0, range=0..100))
separator_3 = CreateSeparator(Thickness=0.5, Horizontal=True, Color=colour_5, Width=width_21, Height=separatorheight_3)
merge = Merge(
    Data1=separator,
    Data2=label_4,
    Data3=label_3,
    Data4=radiobtn_5,
    Data5=radiobtn_6,
    Data6=radiobtn_7,
    Data8=separator_3,
    Data9=label_2,
    Data10=true_button_2,
    Data12=true_button,
    Data13=slider_3,
    Data14=slider_4,
    Data15=slider_2,
    Data16=slider,
    Data17=separator_2,
    Data18=checkbox,
    Data19=button_2)
stack = CreateStack(UIElements=merge, Horizontal=Toggle(False))
hideshow_4 = HideShowElement(ElementToHideShow=stack, Show=python.a, Collapse=Toggle(True), Disable=Toggle(False))

# ---- group: Continuous Motion
separatorheight_4 = Slider(4, range=0..10)
colour_6 = ColourPicker(PickedColour=RGB(230, 230, 230))
colour_7 = ColourPicker(PickedColour=RGB(101, 168, 99))
separatorheight_5 = Slider(10, range=0..10)
strength_2 = Slider(0.5, range=0..1)
colour_8 = ColourPicker(PickedColour=RGB(230, 230, 230))
width_22 = Slider(400, range=0..1000)
width_23 = Slider(110, range=0..1000)
height_20 = Slider(35, range=0..1000)
width_24 = Slider(380, range=0..400)
height_21 = Slider(30, range=0..30)
width_25 = Slider(566, range=0..1000)
height_22 = Slider(38, range=0..1000)
titlesize_3 = Slider(20, range=0..30)
width_26 = Slider(145, range=0..1000)
height_23 = Slider(30, range=0..1000)
separator_4 = CreateSeparator(Thickness=0.5, Horizontal=True, Color=colour_6, Height=separatorheight_4)
slider_5 = CreateSlider(Slider=strength_2, ShowBounds=False, ShowTicks=False, ShowTooltip=False, ShowValLabel=True, showLabel=True)
separator_5 = CreateSeparator(Thickness=0.5, Horizontal=True, Color=colour_8, Width=width_22, Height=separatorheight_5)
label_5 = CreateLabel(LabelText="Output trajectory:", LabelSize=12, Justification=0)
width_27 = Slider(130, range=0..1000)
height_24 = Slider(35, range=0..1000)
label_6 = CreateLabel(LabelText="Kinetic Unit for Continuous Motion", LabelSize=12, Justification=0)
label_7 = CreateLabel(LabelText="Load motion action:", LabelSize=12, Justification=0)
adjustpos_21 = AdjustElementPositioning(
    ElementsToAdjust=slider_5,
    Margin="10,5,0,10",
    AbsolutePositioning=False,
    Width=width_24,
    Height=height_21,
    HorizontalAlignment=Slider(0, range=0..100))
adjustpos_22 = AdjustElementPositioning(
    ElementsToAdjust=label_5,
    Margin="10,-10,0,10",
    AbsolutePositioning=False,
    Width=width_23,
    Height=height_20,
    HorizontalAlignment=Slider(0, range=0..100))
adjustpos_23 = AdjustElementPositioning(
    ElementsToAdjust=label_6,
    Margin="10,5,0,10",
    AbsolutePositioning=False,
    Width=width_25,
    Height=height_22,
    HorizontalAlignment=Slider(0, range=0..100))
adjustelem_3 = AdjustElementAppearance(ElementsToAdjust=label_6, Foreground=colour_7, FontSize=titlesize_3)
distance = Slider(10, range=0..20)
width_28 = Slider(450, range=0..1000)
height_25 = Slider(35, range=0..1000)
separatorheight_6 = Slider(4, range=0..10)
adjustpos_24 = AdjustElementPositioning(
    ElementsToAdjust=label_7,
    Margin="10,5,0,10",
    AbsolutePositioning=False,
    Width=width_27,
    Height=height_24,
    HorizontalAlignment=Slider(0, range=0..100))
checkbox_2 = CreateCheckbox(Label="Add a lock", StartingValue=False)
colour_9 = ColourPicker(PickedColour=RGB(230, 230, 230))
width_29 = Slider(110, range=0..1000)
height_26 = Slider(35, range=0..1000)
height_27 = Slider(30, range=0..30)
width_30 = Slider(380, range=0..400)
width_31 = Slider(400, range=0..1000)
height_28 = Slider(38, range=0..1000)
label_8 = CreateLabel(LabelText="Continuous Motion", LabelSize=12, Justification=0)
width_32 = Slider(566, range=0..1000)
adjustpos_25 = AdjustElementPositioning(ElementsToAdjust=checkbox_2, Margin="15,5,0,10", AbsolutePositioning=False, Width=width_28, Height=height_25)
width_33 = Slider(110, range=0..1000)
height_29 = Slider(35, range=0..1000)
slider_6 = CreateSlider(Slider=distance, ShowBounds=False, ShowTicks=False, ShowTooltip=False, ShowValLabel=True, showLabel=True)
radiobtn_8 = CreateRadioButton(RadioButtonName="Turn", RadioButtonGroup="continuous_motion_input_action", InitiallySelected=False)
radiobtn_9 = CreateRadioButton(RadioButtonName="Line", RadioButtonGroup="continuous_motion_output_behavior", InitiallySelected=False)
adjustpos_26 = AdjustElementPositioning(
    ElementsToAdjust=slider_6,
    Margin="10,0,0,10",
    AbsolutePositioning=False,
    Width=width_30,
    Height=height_27,
    HorizontalAlignment=Slider(0, range=0..100))
separator_6 = CreateSeparator(Thickness=0.5, Horizontal=True, Color=colour_9, Width=width_31, Height=separatorheight_6)
adjustpos_27 = AdjustElementPositioning(
    ElementsToAdjust=label_8,
    Margin="10,5,0,10",
    AbsolutePositioning=False,
    Width=width_32,
    Height=height_28,
    HorizontalAlignment=Slider(0, range=0..100))
height_30 = Slider(30, range=0..1000)
width_34 = Slider(80, range=0..1000)
width_35 = Slider(125, range=0..1000)
adjustpos_28 = AdjustElementPositioning(
    ElementsToAdjust=radiobtn_9,
    Margin="125,-55,0,10",
    AbsolutePositioning=False,
    Width=width_29,
    Height=height_26,
    HorizontalAlignment=Slider(0, range=0..100))
height_31 = Slider(30, range=0..1000)
adjustpos_29 = AdjustElementPositioning(
    ElementsToAdjust=radiobtn_8,
    Margin="135,-55,0,10",
    AbsolutePositioning=False,
    Width=width_33,
    Height=height_29,
    HorizontalAlignment=Slider(0, range=0..100))
width_36 = Slider(200, range=0..1000)
height_32 = Slider(30, range=0..1000)
titlesize_4 = Slider(20, range=0..30)
colour_10 = ColourPicker(PickedColour=RGB(51, 121, 200))
button_3 = CreateButton(ButtonName="Preview", ButtonStyle=0)
true_button_3 = CreateTrueOnlyButton(ButtonName="Select the end-effector", ButtonStyle=0)
true_button_4 = CreateTrueOnlyButton(ButtonName="Set the input", ButtonStyle=0)
rounds_2 = Slider(10, range=0..20)
width_37 = Slider(115, range=0..1000)
height_33 = Slider(35, range=0..1000)
adjustpos_30 = AdjustElementPositioning(
    ElementsToAdjust=button_3,
    Margin="180,-45,0,10",
    AbsolutePositioning=False,
    Width=width_36,
    Height=height_32,
    HorizontalAlignment=Slider(0, range=0..100))
adjustpos_31 = AdjustElementPositioning(
    ElementsToAdjust=true_button_3,
    Margin="260,-40,0,15",
    AbsolutePositioning=False,
    Width=width_35,
    Height=height_31,
    HorizontalAlignment=Slider(0, range=0..100))
adjustpos_32 = AdjustElementPositioning(
    ElementsToAdjust=true_button_4,
    Margin="170,-40,0,10",
    AbsolutePositioning=False,
    Width=width_34,
    Height=height_30,
    HorizontalAlignment=Slider(0, range=0..100))
adjustelem_4 = AdjustElementAppearance(ElementsToAdjust=label_8, Foreground=colour_10, FontSize=titlesize_4)
radiobtn_10 = CreateRadioButton(RadioButtonName="Circle", RadioButtonGroup="continuous_motion_output_behavior", InitiallySelected=False)
width_38 = Slider(380, range=0..400)
height_34 = Slider(30, range=0..30)
radiobtn_11 = CreateRadioButton(RadioButtonName="Press", RadioButtonGroup="continuous_motion_input_action", InitiallySelected=False)
width_39 = Slider(115, range=0..1000)
height_35 = Slider(35, range=0..1000)
slider_7 = CreateSlider(Slider=rounds_2, ShowBounds=False, ShowTicks=False, ShowTooltip=False, ShowValLabel=True, showLabel=True)
adjustpos_33 = AdjustElementPositioning(
    ElementsToAdjust=radiobtn_10,
    Margin="190,-55,0,10",
    AbsolutePositioning=False,
    Width=width_37,
    Height=height_33,
    HorizontalAlignment=Slider(0, range=0..100))
adjustpos_34 = AdjustElementPositioning(
    ElementsToAdjust=radiobtn_11,
    Margin="190,-55,0,10",
    AbsolutePositioning=False,
    Width=width_39,
    Height=height_35,
    HorizontalAlignment=Slider(0, range=0..100))
adjustpos_35 = AdjustElementPositioning(
    ElementsToAdjust=slider_7,
    Margin="10,0,0,10",
    AbsolutePositioning=False,
    Width=width_38,
    Height=height_34,
    HorizontalAlignment=Slider(0, range=0..100))
values_9 = ValueListener(Elements=radiobtn_10, SomeProperty=True)  # -> Values, Indices
values_10 = ValueListener(Elements=radiobtn_9, SomeProperty=True)  # -> Values, Indices
python_3 = GhPythonScript(x=values_10.Values, y=values_9.Values)  # -> a, b, c
# ---------- python_3: Python ----------
"""Provides a scripting component.
    Inputs:
        x: Line
        y: Circle
    Output:
        a: Button 1 label
        b: The slide bar for translation
        c: The slide bar for rotation"""

__author__ = "ediga"
__version__ = "2020.08.18"

import rhinoscriptsyntax as rs

if x and not y:
    # translation
    a = "Set the region and direction"
    b = True
    c = False
elif not x and y:
    # rotation
    a = "Set the region and axis"
    b = False
    c = True
else:
    a = "Set the region and direction"
    b = True
    c = False
# ---------- end python_3 ----------
panel_2 = Panel(python_3.a)
true_button_5 = CreateTrueOnlyButton(ButtonName=panel_2, ButtonStyle=0)
adjustpos_36 = AdjustElementPositioning(
    ElementsToAdjust=true_button_5,
    Margin="15,0,0,10",
    AbsolutePositioning=False,
    Width=width_26,
    Height=height_23,
    HorizontalAlignment=Slider(0, range=0..100))
hideshow_5 = HideShowElement(ElementToHideShow=slider_6, Show=python_3.b, Collapse=Toggle(True), Disable=Toggle(False))
hideshow_6 = HideShowElement(ElementToHideShow=slider_7, Show=python_3.c, Collapse=Toggle(True), Disable=Toggle(False))
merge_2 = Merge(
    Data1=separator_4,
    Data2=label_8,
    Data3=label_7,
    Data4=radiobtn_8,
    Data5=radiobtn_11,
    Data7=label_5,
    Data8=radiobtn_9,
    Data9=radiobtn_10,
    Data10=separator_6,
    Data11=label_6,
    Data12=true_button_5,
    Data14=true_button_4,
    Data15=true_button_3,
    Data16=slider_5,
    Data17=slider_6,
    Data18=slider_7,
    Data19=separator_5,
    Data20=checkbox_2,
    Data21=button_3)
stack_2 = CreateStack(UIElements=merge_2, Horizontal=Toggle(False))
values_11 = ValueListener(Elements=radiobtn_11, SomeProperty=True)  # -> Values, Indices
values_12 = ValueListener(Elements=radiobtn_8, SomeProperty=True)  # -> Values, Indices
hideshow_7 = HideShowElement(ElementToHideShow=stack_2, Show=python.b, Collapse=Toggle(True), Disable=Toggle(False))

# ---- group: Reciprocated Motion
strength_3 = Slider(0.5, range=0..1)
amplitude = Slider(10, range=0..20)
height_36 = Slider(30, range=0..30)
width_40 = Slider(380, range=0..400)
colour_11 = ColourPicker(PickedColour=RGB(101, 168, 99))
colour_12 = ColourPicker(PickedColour=RGB(230, 230, 230))
titlesize_5 = Slider(20, range=0..30)
width_41 = Slider(385, range=0..400)
height_37 = Slider(30, range=0..30)
width_42 = Slider(566, range=0..1000)
height_38 = Slider(38, range=0..1000)
slider_8 = CreateSlider(Slider=strength_3, ShowBounds=False, ShowTicks=False, ShowTooltip=False, ShowValLabel=True, showLabel=True)
slider_9 = CreateSlider(Slider=amplitude, ShowBounds=False, ShowTicks=False, ShowTooltip=False, ShowValLabel=True, showLabel=True)
width_43 = Slider(110, range=0..1000)
height_39 = Slider(35, range=0..1000)
separatorheight_7 = Slider(4, range=0..10)
width_44 = Slider(400, range=0..1000)
label_9 = CreateLabel(LabelText="Kinetic Unit for Reciprocated Motion", LabelSize=12, Justification=0)
adjustelem_5 = AdjustElementAppearance(ElementsToAdjust=label_9, Foreground=colour_11, FontSize=titlesize_5)
adjustpos_37 = AdjustElementPositioning(
    ElementsToAdjust=slider_8,
    Margin="10,5,0,5",
    AbsolutePositioning=False,
    Width=width_40,
    Height=height_36,
    HorizontalAlignment=Slider(0, range=0..100))
separatorheight_8 = Slider(4, range=0..10)
separator_7 = CreateSeparator(Thickness=0.5, Horizontal=True, Color=colour_12, Height=separatorheight_8)
adjustpos_38 = AdjustElementPositioning(
    ElementsToAdjust=slider_9,
    Margin="10,0,0,0",
    AbsolutePositioning=False,
    Width=width_41,
    Height=height_37,
    HorizontalAlignment=Slider(0, range=0..100))
adjustpos_39 = AdjustElementPositioning(
    ElementsToAdjust=label_9,
    Margin="10,5,0,20",
    AbsolutePositioning=False,
    Width=width_42,
    Height=height_38,
    HorizontalAlignment=Slider(0, range=0..100))
height_40 = Slider(34, range=0..1000)
width_45 = Slider(150, range=0..1000)
label_10 = CreateLabel(LabelText="Output trajectory:", LabelSize=12, Justification=0)
colour_13 = ColourPicker(PickedColour=RGB(230, 230, 230))
width_46 = Slider(450, range=0..1000)
label_11 = CreateLabel(LabelText="Reciprocated Motion", LabelSize=12, Justification=0)
panel_3 = Panel("""Uniform
Modified uniform
Uniform acceleration & deceleration""")
adjustpos_40 = AdjustElementPositioning(
    ElementsToAdjust=label_10,
    Margin="10,5,0,10",
    AbsolutePositioning=False,
    Width=width_43,
    Height=height_39,
    HorizontalAlignment=Slider(0, range=0..100))
button_4 = CreateButton(ButtonName="Preview", ButtonStyle=0)
height_41 = Slider(35, range=0..1000)
width_47 = Slider(566, range=0..1000)
height_42 = Slider(38, range=0..1000)
pulldown = CreatePulldownMenu(Label="Pattern", ListItems=panel_3, showLabel=True)
width_48 = Slider(110, range=0..1000)
height_43 = Slider(35, range=0..1000)
width_49 = Slider(215, range=0..1000)
height_44 = Slider(30, range=0..1000)
checkbox_3 = CreateCheckbox(Label="Add a lock", StartingValue=False)
separator_8 = CreateSeparator(Thickness=0.5, Horizontal=True, Color=colour_13, Width=width_44, Height=separatorheight_7)
adjustpos_41 = AdjustElementPositioning(
    ElementsToAdjust=pulldown,
    Margin="10,0,0,10",
    AbsolutePositioning=False,
    Width=width_45,
    Height=height_40,
    HorizontalAlignment=Slider(0, range=0..100))
radiobtn_12 = CreateRadioButton(RadioButtonName="Line", RadioButtonGroup="reciprocated_motion_output", InitiallySelected=False)
width_50 = Slider(80, range=0..1000)
height_45 = Slider(30, range=0..1000)
adjustpos_42 = AdjustElementPositioning(ElementsToAdjust=checkbox_3, Margin="15,5,0,10", AbsolutePositioning=False, Width=width_46, Height=height_41)
width_51 = Slider(125, range=0..1000)
repetitions = Slider(10, range=0..20)
height_46 = Slider(30, range=0..1000)
height_47 = Slider(30, range=0..1000)
width_52 = Slider(145, range=0..1000)
adjustpos_43 = AdjustElementPositioning(
    ElementsToAdjust=button_4,
    Margin="165,-45,0,10",
    AbsolutePositioning=False,
    Width=width_49,
    Height=height_44,
    HorizontalAlignment=Slider(0, range=0..100))
adjustpos_44 = AdjustElementPositioning(
    ElementsToAdjust=label_11,
    Margin="10,5,0,10",
    AbsolutePositioning=False,
    Width=width_47,
    Height=height_42,
    HorizontalAlignment=Slider(0, range=0..100))
adjustpos_45 = AdjustElementPositioning(
    ElementsToAdjust=radiobtn_12,
    Margin="125,-55,0,10",
    AbsolutePositioning=False,
    Width=width_48,
    Height=height_43,
    HorizontalAlignment=Slider(0, range=0..100))
separatorheight_9 = Slider(10, range=0..10)
colour_14 = ColourPicker(PickedColour=RGB(230, 230, 230))
width_53 = Slider(400, range=0..1000)
height_48 = Slider(30, range=0..30)
width_54 = Slider(170, range=0..400)
colour_15 = ColourPicker(PickedColour=RGB(51, 121, 200))
true_button_6 = CreateTrueOnlyButton(ButtonName="Select the end-effector", ButtonStyle=0)
true_button_7 = CreateTrueOnlyButton(ButtonName="Set the input", ButtonStyle=0)
slider_10 = CreateSlider(Slider=repetitions, ShowBounds=False, ShowTicks=False, ShowTooltip=False, ShowValLabel=True, showLabel=True)
adjustpos_46 = AdjustElementPositioning(
    ElementsToAdjust=true_button_6,
    Margin="260,-40,0,15",
    AbsolutePositioning=False,
    Width=width_51,
    Height=height_46,
    HorizontalAlignment=Slider(0, range=0..100))
adjustpos_47 = AdjustElementPositioning(
    ElementsToAdjust=true_button_7,
    Margin="170,-40,0,10",
    AbsolutePositioning=False,
    Width=width_50,
    Height=height_45,
    HorizontalAlignment=Slider(0, range=0..100))
separator_9 = CreateSeparator(Thickness=0.5, Horizontal=True, Color=colour_14, Width=width_53, Height=separatorheight_9)
adjustpos_48 = AdjustElementPositioning(
    ElementsToAdjust=slider_10,
    Margin="170,-55,0,5",
    AbsolutePositioning=False,
    Width=width_54,
    Height=height_48,
    HorizontalAlignment=Slider(0, range=0..100))
height_49 = Slider(35, range=0..1000)
width_55 = Slider(115, range=0..1000)
titlesize_6 = Slider(20, range=0..30)
adjustelem_6 = AdjustElementAppearance(ElementsToAdjust=label_11, Foreground=colour_15, FontSize=titlesize_6)
radiobtn_13 = CreateRadioButton(RadioButtonName="Arc", RadioButtonGroup="reciprocated_motion_output", InitiallySelected=False)
values_13 = ValueListener(Elements=radiobtn_12, SomeProperty=True)  # -> Values, Indices
values_14 = ValueListener(Elements=radiobtn_13, SomeProperty=True)  # -> Values, Indices
adjustpos_49 = AdjustElementPositioning(
    ElementsToAdjust=radiobtn_13,
    Margin="190,-55,0,10",
    AbsolutePositioning=False,
    Width=width_55,
    Height=height_49,
    HorizontalAlignment=Slider(0, range=0..100))
python_4 = GhPythonScript(x=values_13.Values, y=values_14.Values)  # -> a
# ---------- python_4: Python ----------
"""Provides a scripting component.
    Inputs:
        x: Line
        y: Arc
    Output:
        a: Button 1 label"""

__author__ = "ediga"
__version__ = "2020.08.19"

import rhinoscriptsyntax as rs

if x and not y:
    a = "Set the region and direction"
elif not x and y:
    a = "Set the region and axis"
else:
    a = "Set the region and direction"
# ---------- end python_4 ----------
panel_4 = Panel(python_4)
true_button_8 = CreateTrueOnlyButton(ButtonName=panel_4, ButtonStyle=0)
adjustpos_50 = AdjustElementPositioning(
    ElementsToAdjust=true_button_8,
    Margin="15,0,0,10",
    AbsolutePositioning=False,
    Width=width_52,
    Height=height_47,
    HorizontalAlignment=Slider(0, range=0..100))
merge_3 = Merge(
    Data1=separator_7,
    Data2=label_11,
    Data3=label_10,
    Data4=radiobtn_12,
    Data5=radiobtn_13,
    Data9=separator_8,
    Data10=label_9,
    Data11=true_button_8,
    Data13=true_button_7,
    Data14=true_button_6,
    Data15=slider_8,
    Data16=pulldown,
    Data18=slider_10,
    Data19=slider_9,
    Data22=separator_9,
    Data23=checkbox_3,
    Data24=button_4)
stack_3 = CreateStack(UIElements=merge_3, Horizontal=Toggle(False))
hideshow_8 = HideShowElement(ElementToHideShow=stack_3, Show=python.c, Collapse=Toggle(True), Disable=Toggle(False))

# ---- group: Intermittent Motion
separatorheight_10 = Slider(4, range=0..10)
separatorheight_11 = Slider(10, range=0..10)
colour_16 = ColourPicker(PickedColour=RGB(101, 168, 99))
colour_17 = ColourPicker(PickedColour=RGB(230, 230, 230))
colour_18 = ColourPicker(PickedColour=RGB(230, 230, 230))
width_56 = Slider(400, range=0..1000)
width_57 = Slider(566, range=0..1000)
height_50 = Slider(38, range=0..1000)
titlesize_7 = Slider(20, range=0..30)
label_12 = CreateLabel(LabelText="Kinetic Unit for Intermittent Motion", LabelSize=12, Justification=0)
separator_10 = CreateSeparator(Thickness=0.5, Horizontal=True, Color=colour_18, Width=width_56, Height=separatorheight_11)
separator_11 = CreateSeparator(Thickness=0.5, Horizontal=True, Color=colour_17, Height=separatorheight_10)
width_58 = Slider(145, range=0..1000)
height_51 = Slider(30, range=0..1000)
adjustpos_51 = AdjustElementPositioning(
    ElementsToAdjust=label_12,
    Margin="10,0,0,20",
    AbsolutePositioning=False,
    Width=width_57,
    Height=height_50,
    HorizontalAlignment=Slider(0, range=0..100))
adjustelem_7 = AdjustElementAppearance(ElementsToAdjust=label_12, Foreground=colour_16, FontSize=titlesize_7)
width_59 = Slider(566, range=0..1000)
height_52 = Slider(38, range=0..1000)
width_60 = Slider(80, range=0..1000)
height_53 = Slider(30, range=0..1000)
times = Slider(10, range=0..20)
amplitude_2 = Slider(10, range=0..20)
strength_4 = Slider(0.5, range=0..1)
width_61 = Slider(380, range=0..400)
height_54 = Slider(30, range=0..30)
width_62 = Slider(380, range=0..400)
width_63 = Slider(380, range=0..400)
true_button_9 = CreateTrueOnlyButton(ButtonName="Set the region and direction", ButtonStyle=0)
width_64 = Slider(125, range=0..1000)
height_55 = Slider(30, range=0..30)
height_56 = Slider(30, range=0..30)
height_57 = Slider(30, range=0..1000)
label_13 = CreateLabel(LabelText="Intermittent Motion", LabelSize=12, Justification=0)
true_button_10 = CreateTrueOnlyButton(ButtonName="Set the input", ButtonStyle=0)
width_65 = Slider(200, range=0..1000)
adjustpos_52 = AdjustElementPositioning(
    ElementsToAdjust=true_button_9,
    Margin="15,0,0,10",
    AbsolutePositioning=False,
    Width=width_58,
    Height=height_51,
    HorizontalAlignment=Slider(0, range=0..100))
height_58 = Slider(30, range=0..1000)
adjustpos_53 = AdjustElementPositioning(
    ElementsToAdjust=label_13,
    Margin="10,5,0,5",
    AbsolutePositioning=False,
    Width=width_59,
    Height=height_52,
    HorizontalAlignment=Slider(0, range=0..100))
adjustpos_54 = AdjustElementPositioning(
    ElementsToAdjust=true_button_10,
    Margin="170,-40,0,10",
    AbsolutePositioning=False,
    Width=width_60,
    Height=height_53,
    HorizontalAlignment=Slider(0, range=0..100))
width_66 = Slider(450, range=0..1000)
height_59 = Slider(35, range=0..1000)
button_5 = CreateButton(ButtonName="Preview", ButtonStyle=0)
slider_11 = CreateSlider(Slider=strength_4, ShowBounds=False, ShowTicks=False, ShowTooltip=False, ShowValLabel=True, showLabel=True)
true_button_11 = CreateTrueOnlyButton(ButtonName="Select the end-effector", ButtonStyle=0)
slider_12 = CreateSlider(Slider=times, ShowBounds=False, ShowTicks=False, ShowTooltip=False, ShowValLabel=True, showLabel=True)
slider_13 = CreateSlider(Slider=amplitude_2, ShowBounds=False, ShowTicks=False, ShowTooltip=False, ShowValLabel=True, showLabel=True)
checkbox_4 = CreateCheckbox(Label="Add a lock", StartingValue=False)
adjustpos_55 = AdjustElementPositioning(
    ElementsToAdjust=button_5,
    Margin="180,-45,0,10",
    AbsolutePositioning=False,
    Width=width_65,
    Height=height_58,
    HorizontalAlignment=Slider(0, range=0..100))
adjustpos_56 = AdjustElementPositioning(
    ElementsToAdjust=true_button_11,
    Margin="260,-40,0,20",
    AbsolutePositioning=False,
    Width=width_64,
    Height=height_57,
    HorizontalAlignment=Slider(0, range=0..100))
adjustpos_57 = AdjustElementPositioning(ElementsToAdjust=checkbox_4, Margin="15,15,0,10", AbsolutePositioning=False, Width=width_66, Height=height_59)
adjustpos_58 = AdjustElementPositioning(
    ElementsToAdjust=slider_11,
    Margin="10,15,0,20",
    AbsolutePositioning=False,
    Width=width_61,
    Height=height_54,
    HorizontalAlignment=Slider(0, range=0..100))
adjustpos_59 = AdjustElementPositioning(
    ElementsToAdjust=slider_12,
    Margin="10,0,0,5",
    AbsolutePositioning=False,
    Width=width_62,
    Height=height_55,
    HorizontalAlignment=Slider(0, range=0..100))
adjustpos_60 = AdjustElementPositioning(
    ElementsToAdjust=slider_13,
    Margin="10,15,0,15",
    AbsolutePositioning=False,
    Width=width_63,
    Height=height_56,
    HorizontalAlignment=Slider(0, range=0..100))
titlesize_8 = Slider(20, range=0..30)
colour_19 = ColourPicker(PickedColour=RGB(51, 121, 200))
adjustelem_8 = AdjustElementAppearance(ElementsToAdjust=label_13, Foreground=colour_19, FontSize=titlesize_8)
merge_4 = Merge(
    Data1=separator_11,
    Data2=label_13,
    Data3=label_12,
    Data4=true_button_9,
    Data6=true_button_10,
    Data7=true_button_11,
    Data8=slider_11,
    Data9=slider_12,
    Data10=slider_13,
    Data11=separator_10,
    Data12=checkbox_4,
    Data13=button_5)
stack_4 = CreateStack(UIElements=merge_4, Horizontal=Toggle(False))
hideshow_9 = HideShowElement(ElementToHideShow=stack_4, Show=python.d, Collapse=Toggle(True), Disable=Toggle(False))

# ---- group: Default Control Panel
width_67 = Slider(860, range=0..1000)
height_60 = Slider(35, range=0..1000)
colour_20 = ColourPicker(PickedColour=RGB(200, 200, 200))
label_14 = CreateLabel(LabelText="Please select the target motion...", LabelSize=12, Justification=0)
adjustpos_61 = AdjustElementPositioning(
    ElementsToAdjust=label_14,
    Margin="100,180,0,10",
    AbsolutePositioning=False,
    Width=width_67,
    Height=height_60,
    HorizontalAlignment=Slider(0, range=0..100))
stack_5 = CreateStack(UIElements=label_14, Horizontal=Toggle(False))
hideshow_10 = HideShowElement(ElementToHideShow=stack_5, Show=python.e, Collapse=Toggle(True), Disable=Toggle(False))
adjustelem_9 = AdjustElementAppearance(ElementsToAdjust=label_14, Foreground=colour_20)

# ----
arc = Panel(values_14.Values)
line = Panel(values_13.Values)
turn_input = Panel(values_12.Values)
press_input = Panel(values_11.Values)
line_2 = Panel(values_10.Values)
circle = Panel(values_9.Values)
panel_5 = Panel(python.b)
panel_6 = Panel(python.a)
panel_7 = Panel(python.c)
panel_8 = Panel(python.e)
line_3 = Panel(values_6.Values)
panel_9 = Panel(python.d)
circle_2 = Panel(values_7.Values)
arc_2 = Panel(values_8.Values)

# ---- group: MAIN WINDOW
merge_5 = Merge(
    Data1=label,
    Data2=radiobtn_3,
    Data3=radiobtn_4,
    Data4=radiobtn_2,
    Data5=radiobtn,
    Data7=stack_5,
    Data8=stack,
    Data9=stack_2,
    Data10=stack_3,
    Data11=stack_4)
launchwin = LaunchWindow(
    Show=Toggle(True),
    Name="Kinergy Design Tool",
    Width=Slider(410, range=0..1000),
    Height=Slider(520, range=0..1000),
    ChildStatus=0,
    EnableHorizScroll=False)
addelems = AddElements(Window=launchwin, Elements=flatten(merge_5), DoVLChecking=True)  # -> AddedElements, ElementNames
